# Grasshopper definition ColBot_Grasshopper3d_example_01_basic.gh (Grasshopper 1.0.7)
# plug-ins: AECforward

number_slider = Slider(4000, range=0..10000)
pt = ConstructPoint(XCoordinate=0, YCoordinate=0, ZCoordinate=0)
pt_2 = ConstructPoint(XCoordinate=0, YCoordinate=0, ZCoordinate=4000)
list = ValueList({"low carbon": "carbon", "cost", "minmum size": "size", "baseline": "weight_S355"}, selected="baseline")
list_2 = ValueList({"low carbon": "carbon", "cost", "minmum size": "size", "baseline": "weight_S355"}, selected="low carbon")
# ColBot – Readme
# 
# Questions? Comments? or want full detailed calculations?
# Please email us at bots@AECforward.ai.
# 
# What is this about
# ColBot is predicting the best structural steel column (UK market). The column of height Ly is loaded by an axial force N and some bending moments.
# The best selected columns have different grades S355, S460 and different steel making processes BOF (basic oxygene furnace) or EAF (Electric Arc Furnace).
# The option weight_S355 corresponds to a baseline basic design using S355.
# The carbon option considers the embodied carbon for the production stages A1-A3.
# 
# 
# Disclaimer
# AECforward.ai own all intellectual property rights to the apps, API, components associated with ColBot.
# This design has been generated automatically using a machine learning process and hence is approximate.
# The Information provided is for Informational/Educational purposes only and should not be treated as a substitute for or replacement of professional structural engineering advice.
# AECforward cannot be held responsible for commercial use of the information provided.
panel = Panel("5000000")
ln = Line(StartPoint=pt, EndPoint=pt_2)
colbot = ColBot(
    Load=panel,
    BendingMomentMy=0,
    BendingMomentMz=0,
    ColumnHeight=4000,
    CarbonSizeCostWeight_S355=[list, list_2],
    ColumnAxis=ln)  # -> flatten(Section), SteelGrade, Comments
panel_2 = Panel(colbot.Section)
panel_3 = Panel(colbot.SteelGrade)
list_3 = ValueList({"carbon A1-A3": "carbon", "cost", "minmum size": "size", "weight", "Inertia": "Iy", "height": "h"}, selected="carbon A1-A3")
panel_4 = Panel(colbot.Comments)
sectionprop = SteelSectionsProperties(SectionName=colbot.Section, Grade=colbot.SteelGrade, Property=list_3)  # -> Value, Description
panel_5 = Panel(sectionprop.Description)
panel_6 = Panel(sectionprop.Value)
