# Grasshopper definition ColBot_Grasshopper3d_example_02_truss_iterative.gh (Grasshopper 1.0.7)
# Copyright: B+G Engineers
# plug-ins: BullAnt, karambaGH, AECforward, LunchBox

buckling_length = Panel("""10000
10000
2000""")

# ---- group: Loads
panel = Panel("""CHORD_BOTTOM
CHORD_TOP""")
load_multiplier = Slider(-100, range=-200..0)
Z = UnitZ(Factor=load_multiplier)
loads = LoadsKaramba3D(Vector=Z, BeamIdentifiers=panel, LCase=0, mode="Uniform Line", menu=[buttons(on, off, off)])

# ---- group: LunchBox truss (Alternative)
truss = _2DTruss(Divisions=10, TrussToggle=0)  # -> PrimaryLines, BraceLines, VerticalLines, StructureNodes

# ----
panel_2 = Panel("""CHORD_BOTTOM
CHORD_TOP
DIAGONALS
VERTICALS""")
merge = Merge(
    Data1=ColourSwatch(SwatchColor=RGB(0, 42, 255)),
    Data2=ColourSwatch(SwatchColor=RGB(246, 42, 255)),
    Data3=ColourSwatch(SwatchColor=RGB(0, 245, 255)),
    Data4=ColourSwatch(SwatchColor=RGB(152, 230, 49)))  # -> graft(Result)
panel_3 = Panel("""CHORD_BOTTOM
CHORD_TOP
DIAGONALS
VERTICALS""")

# ---- group: ColBot cross section selection
number_slider = Slider(4060, range=3000..5000)
list = ValueList({"Low carbon": "carbon", "cost", "size", "baseline": "weight_S355"}, selected="Low carbon")

# ---- group: Section Properties
list_2 = ValueList({"Carbon A1-A3": "carbon", "Cost": "cost", "height": "h", "weight"}, selected="Cost")

# ---- group: Sections iterations
start_iteration = Panel("""UC254x254x89
UC254x254x132
UC254x254x107""")

# ---- group: Truss geometry
height = Slider(3, range=0..10)
length = Slider(16, range=0..20)
subdivisions = Slider(7, range=0..10)
pt = ConstructPoint(XCoordinate=0, YCoordinate=0, ZCoordinate=0)
pt_2 = ConstructPoint(XCoordinate=0, YCoordinate=0, ZCoordinate=height)
pt_3 = ConstructPoint(XCoordinate=length, YCoordinate=0, ZCoordinate=0)
pt_4 = ConstructPoint(XCoordinate=length, YCoordinate=0, ZCoordinate=height)
ln = Line(StartPoint=pt, EndPoint=pt_3)
ln_2 = Line(StartPoint=pt_2, EndPoint=pt_4)
pt_5 = Point(pt)

# ---- group: Truss geometry / GeometryGym BullAnt Truss
type = Slider(2, range=0..5)
ggtc = GgTrussFromCurves(FirstCurve=ln, SecondCurve=ln_2, NumberDivision=subdivisions, TrussType=type, Frames=Toggle(True))  # -> ChordACurves, ChordBCurves, Diagonals, Verticals

# ---- group: Truss geometry (continued)
entwine = Entwine(
    Branch00=ggtc.ChordACurves,
    Branch01=ggtc.ChordBCurves,
    Branch02=ggtc.Diagonals,
    Branch03=ggtc.Verticals,
    FlattenInputs=True)
line = Line(entwine)

# ----
pt_6 = Point(pt_3)

# ---- group: Cross sections
matselect = MaterialSelectionKaramba3D(menu=[dropdown(1), dropdown(4)])
crosecrselect = CrossSectionRangeSelectorKaramba3D(MaximumHeight_cm=-1, MaximumWidth_cm=-1, Material=matselect, menu=[dropdown(2), dropdown(1), dropdown(2)])

# ---- group: Karamba FE Solver
supp = SupportKaramba3D(PosInd=pt_5, menu=[buttons(on, on, on, on, off, on)])
supp_2 = SupportKaramba3D(PosInd=pt_6, menu=[buttons(off, on, on, on, off, on)])

# ----
moments_in_knm = Panel(forces_in_kn_2)

# ---- group: ColBot cross section selection (continued)
multiplication = Multiplication(A=moments_in_knm, B=1000000)

# ----
forces_in_kn_comp = Panel(forces_in_kn)
multiplication_2 = Multiplication(A=forces_in_kn_comp, B=-1)

# ---- group: ColBot cross section selection (continued)
# ColBot is here!
multiplication_3 = Multiplication(A=multiplication_2, B=1000)
colbot = ColumnBot(
    Load=multiplication_3,
    BendingMomentMy=multiplication,
    BendingMomentMz=0,
    ColumnHeight=buckling_length,
    CarbonSizeCostWeight_S355=list)  # -> Section, SteelGrade, Comments
colbot_sections = Panel(colbot.Section)
grade = Panel(colbot.SteelGrade)
panel_4 = Panel(colbot.Comments)

# ---- group: Sections iterations (continued)
best_sections = Panel(colbot_sections)
# Click on the DataDam
# until the "best Sections"
# match the "Current sections"
dam = DataDam(DataA=best_sections, BufferDelay=10000000, BufferMode=0)  # -> flatten(DataA)
dam_2 = DataDam(DataA=dam, BufferDelay=2500000, BufferMode=2)
current_sections = Panel(dam_2)
filter = StreamFilter(Gate=Slider(0, range=0..1), Stream0=current_sections, Stream1=start_iteration)
txt = Text(filter)

# ---- group: Section Properties (continued)
sectionprop = SteelSectionsProperties(Section=colbot_sections, Grade=grade, Property=list_2)  # -> Value, Description
panel_5 = Panel(sectionprop.Value)
panel_6 = Panel(sectionprop.Description)

# ---- group: Cross sections (continued)
txt_2 = Text(txt)
crosecselect = CrossSectionSelectorKaramba3D(CrossSections=crosecrselect, NameOrListIndexOfCrossSection=txt_2)  # -> flatten(CrossSection), Info

# ---- group: Karamba FE Solver (continued)
linetobeam = LineToBeamKaramba3D(
    Line=line,
    Color=merge,
    Identifier=graft(panel_2),
    CrossSection=graft(crosecselect.CrossSection),
    New=True,
    Remove=True,
    LimitDistance_m=0.005,
    Bending=True)  # -> Element, Points, Info
assemble = AssembleModelKaramba3D(Elem=flatten(linetobeam.Element), Support=[supp, supp_2], Load=loads, LimitDistance_m=0.005)  # -> Model, Info, Mass_kg, CenterOfGravity
analyze = AnalyzeKaramba3D(Model=assemble.Model)  # -> CalculatedModel, MaximumDisplacement_cm, ResultingForceOfGravity_kN, ElasticEnergy_kNm
modelview = ModelViewKaramba3D(Model=analyze.CalculatedModel, LoadCaseFactorsForLinearSuperposition=1, IndexOfVisibleLoadcase=-1)  # -> Model, DeformedMesh, DeformedAxes, DeformedModel

# ----
displacement_cm = Panel(analyze.MaximumDisplacement_cm)

# ---- group: Graphic outputs
beamview = BeamViewKaramba3D(Model=modelview.Model)  # -> Model, MeshesOfRenderedBeams, DeformedBeamAxes, LegendColors, LegendTags
legend = Legend(Colour=beamview.LegendColors, Tags=beamview.LegendTags, LegendType=1)

# ---- group: Forces in members
b_forces = BeamForcesKaramba3D(
    AnalyzedModel=modelview.Model,
    BeamIdentifiers=graft(panel_3),
    LCase=-1,
    MaximumDistanceBetweenResults_m=-1,
    NumberOfResultsPerBeamElement=2)  # -> AnalyzedModel, simplify(NormalForce_kN), ShearForceVz_kN, ShearForceVy_kN, BendingMomentMt_kNm, simplify(BendingMomentMy_kNm), BendingMomentMz_kNm
trim = TrimTree(Tree=b_forces.BendingMomentMy_kNm, Depth=1)
trim_2 = TrimTree(Tree=b_forces.NormalForce_kN, Depth=1)
sort = SortList(Keys=trim)  # -> Keys, ValuesA
sort_2 = SortList(Keys=trim_2)  # -> Keys, ValuesA
item = ListItem(List=reverse(sort.Keys), Index=0, Wrap=True)
item_2 = ListItem(List=sort_2.Keys, Index=0, Wrap=True)
item_3 = ListItem(List=reverse(sort_2.Keys), Index=0, Wrap=True)
item_4 = ListItem(List=sort.Keys, Index=0, Wrap=True)
abs = Absolute(Value=item_2)
abs_2 = Absolute(Value=item_4)
abs_3 = Absolute(Value=item_3)
abs_4 = Absolute(Value=item)
max = Maximum(A=abs_2, B=abs_4)
max_2 = Maximum(A=abs, B=abs_3)
equals = Equality(FirstNumber=abs, SecondNumber=max_2)  # -> Equality, Inequality
num = Number(equals.Equality)
num_2 = Number(equals.Inequality)
multiplication_4 = Multiplication(A=num, B=item_2)
multiplication_5 = Multiplication(A=num_2, B=item_3)
addition = Addition(A=multiplication_4, B=multiplication_5)
forces_in_kn = Number(flatten(addition))
forces_in_kn_2 = Number(flatten(max))

# ----
mesh = Mesh(beamview.MeshesOfRenderedBeams)
forces_in_kn_3 = Panel(forces_in_kn)
moments_in_knm_2 = Panel(forces_in_kn_2)
